# Grasshopper definition 20230617_MS_branching by region subdivision - 3D.gh (Grasshopper 1.0.7)
# plug-ins: Human, Kangaroo2 Components, Pufferfish, Heteroptera

panel = Panel("Ignacio Ubaldini")
panel_2 = Panel("""Generativo
01_Area de trabajo""")

construct_point = ConstructPoint(XCoordinate="0", YCoordinate="0", ZCoordinate="0")

number_slider = Slider(5, range=0..100)
neg = Negative(Value=number_slider)
dom = ConstructDomain(DomainStart=neg, DomainEnd=number_slider)

# ---- group: 50
data = Data("75")

# ----
negative = Negative(Value="2500")
construct_domain = ConstructDomain(DomainStart=negative, DomainEnd="2500")
rectangle = Rectangle(Plane=PlaneXY(0, 0, 0), XSize=construct_domain, YSize=construct_domain, Radius=0)  # -> Rectangle, Length
divide_surface = DivideSurface(Surface=rectangle.Rectangle, UCount=data, VCount=data)  # -> Points, Normals, Parameters
flatten_tree = FlattenTree(Tree=divide_surface.Points, Path="{0}")

# ----
# 01_01_Punto de origen
# 
# 01_02_Boundary
# 
# 01_03_Grilla inicial
number = Number("2500")
number_2 = Number("75")
data_2 = Data(construct_point)
data_3 = Data(rectangle.Rectangle)
data_4 = Data(flatten_tree)

multiplication = Multiplication(A=number, B=2)
Z = UnitZ(Factor=multiplication)
extr = Extrude(Base=data_3, Direction=Z)
cap = CapHoles(Brep=extr)
number_slider_2 = Slider(10, range=0..10)
number_slider_3 = Slider(1000, range=0..1000)
X = UnitX(Factor=Slider(9952, range=0..14100))
debrep = DeconstructBrep(Brep=cap)  # -> Faces, Edges, Vertices
volume = Volume(Geometry=cap)  # -> Volume, Centroid
number_slider_4 = Slider(0.5, range=0..1)
remap = RemapNumbers(Value=number_slider_2, Source="10", Target="360")  # -> Mapped, Clipped
number_slider_5 = Slider(1, range=0..10)
round = Round(Number=number_slider_2)  # -> Nearest, Floor, Ceiling
move = Move(Geometry=volume.Centroid, Motion=X)  # -> Geometry, Transform
rotate = Rotate(Geometry=move.Geometry, Angle=degrees(remap.Mapped), Plane=volume.Centroid)  # -> Geometry, Transform
mod = Modulus(A=number_slider_2, B="1")
X_2 = UnitX(Factor=1)
Y = UnitY(Factor=1)
Z_2 = UnitZ(Factor=1)
merge = Merge(Data1=X_2, Data2=Y, Data3=Z_2)
cluster = Cluster(brep=cap, F=number_slider_4, S=round.Floor, i=number_slider_5)  # -> flatten(A), B
cluster_2 = Cluster(brep=cluster.A, F=number_slider_4, S=expr("x*2", round.Floor), i=number_slider_5)  # -> simplify(A), simplify(B)
cluster_3 = Cluster(brep=cluster_2.A, F=number_slider_4, S=expr("x*3", round.Floor), i=number_slider_5)  # -> simplify(A), simplify(B)
evalsrf = EvaluateSurface(Surface=reparameterize(debrep.Faces), Point=Point(0, 0, 0))  # -> Point, Normal, UDirection, VDirection, Frame
lng = ListLength(List=merge)
random = Random(Range=lng, Number=1, Seed=round.Floor)
camera = CameraCrane(Location=rotate.Geometry, Target=volume.Centroid, Lense=Slider(29, range=0..100), Refresh=True)  # -> Camera, Target, Lens, Up, HorizontalViewAngle, VerticalViewAngle, ScreenRatio, Frame; disabled
merge_2 = Merge(Data1=cluster_3.A, Data2=cluster_3.B)
item = ListItem(List=merge, Index=random, Wrap=True)
abs = Absolute(Value=evalsrf.Normal)
angle = Angle(VectorA=abs, VectorB=item)  # -> Angle, Reflex
equals = Equality(FirstNumber=angle.Angle, SecondNumber="0")  # -> Equality, Inequality
entwine = Entwine(Branch00=cluster.B, Branch01=cluster_2.B, Branch02=merge_2, FlattenInputs=True)
cull = CullPattern(List=debrep.Faces, CullPattern=equals.Equality)
flatten = FlattenTree(Tree=entwine, Path="{0}")
edges = BrepEdges(Brep=entwine)  # -> Naked, Interior, NonManifold
sdivide = DivideSurface(Surface=cull, UCount="25", VCount="25")  # -> simplify(Points), Normals, Parameters
debrep_2 = DeconstructBrep(Brep=entwine)  # -> Faces, Edges, flatten(Vertices)
flatten_2 = FlattenTree(Tree=edges.Interior, Path="{0}")  # -> graft(Tree)
trim = TrimTree(Tree=sdivide.Points, Depth=1)
lng_2 = ListLength(List=trim)
addition = Addition(A=round.Floor, B=1)
crv_cp = CurveClosestPoint(Point=debrep_2.Vertices, Curve=flatten_2)  # -> Point, Parameter, Distance
merge_3 = Merge(Data1=round.Floor, Data2=addition)  # -> graft(Result)
smaller = SmallerThan(FirstNumber=crv_cp.Distance, SecondNumber="0.01")  # -> SmallerThan, OrEqualTo
random_2 = Random(Range=lng_2, Number=1, Seed=merge_3)
number_slider_6 = Slider(30, range=0..100)
cull_2 = CullPattern(List=crv_cp.Parameter, CullPattern=smaller.SmallerThan)
item_2 = ListItem(List=trim, Index=random_2, Wrap=True)  # -> flatten(Item)
item_3 = ListItem(List=item_2, Index=0, Wrap=True)  # -> Item, Item1
ln = Line(StartPoint=item_3.Item, EndPoint=item_3.Item1)
colom = CollisionOneMany(Collider=flatten, Obstacles=ln)  # -> Collision, Index
dispatch = Dispatch(List=flatten, DispatchPattern=colom.Collision)  # -> ListA, ListB
volume_2 = Volume(Geometry=dispatch.ListA)  # -> Volume, Centroid
crv_cp_2 = CurveClosestPoint(Point=volume_2.Centroid, Curve=ln)  # -> Point, Parameter, Distance
shatter = Shatter(Curve=flatten_2, Parameters=cull_2)  # -> flatten(Segments)
sort = SortList(Keys=crv_cp_2.Parameter, ValuesA=volume_2.Centroid)  # -> Keys, ValuesA
midpt = CurveMiddle(Curve=shatter)
merge_4 = Merge(Data1=number_slider_6, Data2=number_slider_6)
cset = CreateSet(List=midpt)  # -> Set, Map
reldif = RelativeDifferences(Values=cset.Map)
merge_5 = Merge(Data1=item_3.Item, Data2=sort.ValuesA, Data3=item_3.Item1)
volume_3 = Volume(Geometry=dispatch.ListB)  # -> Volume, Centroid
nurbs = NurbsCurve(Vertices=merge_5, Degree=3, Periodic=False)  # -> reparameterize(Curve), Length, Domain
larger = LargerThan(FirstNumber=reldif, SecondNumber=0)  # -> LargerThan, OrEqualTo
crv_cp_3 = CurveClosestPoint(Point=volume_3.Centroid, Curve=nurbs.Curve)  # -> Point, Parameter, Distance
dom_2 = ConstructDomain(DomainStart="2", DomainEnd="5")
cull_3 = CullPattern(List=shatter, CullPattern=larger.LargerThan)
dash = DashPattern(Curve=cull_3, Pattern=merge_4)  # -> Dashes, Gaps

previewlw = CustomPreviewLineweights(
    Geometry=dash.Dashes,
    Shader=ColourSwatch(SwatchColor=RGB(128, 128, 128)),
    Thickness=Slider(2, range=0..10),
    Absolute=invert(False))

sort_2 = SortList(Keys=crv_cp_3.Parameter, ValuesA=volume_3.Centroid)  # -> Keys, ValuesA
random_3 = Random(Range=dom_2, Number="10", Seed=round.Floor, Integers=True)
panel_3 = Panel(random_3)
partition = PartitionList(List=sort_2.ValuesA, Size=random_3)  # -> simplify(Chunks)
crv_cp_4 = CurveClosestPoint(Point=partition, Curve=nurbs.Curve)  # -> Point, Parameter, Distance
sort_3 = SortList(Keys=crv_cp_4.Distance, ValuesA=partition, ValuesB=crv_cp_4.Point, ValuesC=crv_cp_4.Parameter)  # -> Keys, simplify(ValuesA), ValuesB, ValuesC
item_4 = ListItem(List=sort_3.ValuesB, Index=0, Wrap=True)  # -> simplify(Item)
item_5 = ListItem(List=sort_3.ValuesC, Index=0, Wrap=True)  # -> simplify(Item)
graph = GraphMapper(mod, x0=0, x1=1, y0=0, y1=1, container_name="Bezier", cpx=[0, 0, 0.3048237264, 1], cpy=[0, 0.4940680861, 1, 1])
graph_2 = GraphMapper(mod, x0=0, x1=1, y0=0, y1=1, container_name="Bezier", cpx=[0, 0, 0.2743999064, 1], cpy=[0, 0.2992244363, 1, 1])
subtraction = Subtraction(A=item_5, B=Slider(0.1, range=0..1))
max = Maximum(A="0", B=subtraction)
eval = EvaluateCurve(Curve=nurbs.Curve, Parameter=max)  # -> Point, Tangent, Angle
dom_3 = ConstructDomain(DomainStart=Slider(100, range=0..500), DomainEnd=Slider(25, range=0..100))
flatten_3 = FlattenTree(Tree=max, Path="{0}")
slideindom = SlideWithinDomain(Domain=dom_3, Factor=flatten_3)
slideindom_2 = SlideWithinDomain(Domain=dom_3, Factor=graph)
multiplication_2 = Multiplication(A=slideindom, B=Slider(0.1, range=0..1))
flatten_4 = FlattenTree(Tree=eval.Point, Path="{0}")
subcrv = SubCurve(BaseCurve=nurbs.Curve, Domain=graph)
dom_4 = ConstructDomain(DomainStart=slideindom, DomainEnd=multiplication_2)  # -> graft(Domain)
merge_6 = Merge(Data1=eval.Point, Data2=item_4, Data3=sort_3.ValuesA)
shatter_2 = Shatter(Curve=nurbs.Curve, Parameters=flatten(max))  # -> simplify(Segments)
lng_3 = ListLength(List=merge_6)
subtraction_2 = Subtraction(A=lng_3, B=1)
shatter_3 = Shatter(Curve=subcrv, Parameters=flatten(max))  # -> simplify(Segments)
subtraction_3 = Subtraction(A="1", B=flatten_3)
subtraction_4 = Subtraction(A=graph, B=flatten_3)
nurbs_2 = NurbsCurve(Vertices=merge_6, Degree=3, Periodic=False)  # -> Curve, Length, Domain
range = Range(Domain=dom_4, Steps=subtraction_2)
remap_2 = RemapNumbers(Value=subtraction_4, Source=subtraction_3, Target=Domain(0, 1))  # -> Mapped, Clipped
subcrv_2 = SubCurve(BaseCurve=flatten(nurbs_2.Curve), Domain=remap_2.Clipped)
end = EndPoints(Curve=subcrv_2)  # -> flatten(Start), flatten(End)
join = JoinCurves(Curves=shatter_3, Preserve=False)
cullpt = CullDuplicates(Points=end.Start, Tolerance=Slider(50, range=0..100), CullMode=3)  # -> Points, Indices, Valence
larger_2 = LargerThan(FirstNumber=cullpt.Indices, SecondNumber=0)  # -> LargerThan, OrEqualTo
cull_4 = CullPattern(List=subcrv_2, CullPattern=larger_2.OrEqualTo)
merge_7 = Merge(Data1=shatter_3, Data2=cull_4)  # -> flatten(Result)
flatten_5 = FlattenTree(Tree=merge_6, Path="{0}")
flatten_6 = FlattenTree(Tree=range, Path="{0}")
end_2 = EndPoints(Curve=flatten(subcrv_2))  # -> Start, End
end_3 = EndPoints(Curve=flatten(join))  # -> Start, End
merge_8 = Merge(Data1=flatten_4, Data2=flatten_5)
project = Project(Geometry=merge_8, Plane=PlaneXY(0, 0, 0))  # -> Geometry, Transform
merge_9 = Merge(Data1=slideindom, Data2=flatten_6)
project_2 = Project(Geometry=merge_7, Plane=PlaneXY(0, 0, 0))  # -> Geometry, Transform
merge_10 = Merge(Data1=merge_9, Data2=slideindom_2, Data3=multiplication_2)
merge_11 = Merge(Data1=merge_8, Data2=end_3.End, Data3=end_2.End)
pull = PullPoint(Point=merge_11, Geometry=merge_7, ClosestOnly=True)  # -> ClosestPoint, Distance
smaller_2 = SmallerThan(FirstNumber=pull.Distance, SecondNumber=".01")  # -> SmallerThan, OrEqualTo
cull_5 = CullPattern(List=merge_11, CullPattern=smaller_2.SmallerThan)
cull_6 = CullPattern(List=merge_10, CullPattern=smaller_2.SmallerThan)
multiplication_3 = Multiplication(A=cull_6, B=graph)
mp = MultiPipe(
    Curves=project_2.Geometry,
    NodeSize=multiplication_3,
    SizePoints=project.Geometry,
    EndOffset=1,
    StrutSize=1,
    Segment=0,
    KinkAngle=0.6,
    CubeFit=0,
    Caps=0)  # disabled
mp_2 = MultiPipe(
    Curves=merge_7,
    NodeSize=multiplication_3,
    SizePoints=cull_5,
    EndOffset=1,
    StrutSize=1,
    Segment=0,
    KinkAngle=0.6,
    CubeFit=0,
    Caps=0)
swatch = ColourSwatch(SwatchColor=RGB(0, 85, 255))
swatch_2 = ColourSwatch(SwatchColor=RGB(225, 255, 0))
material = CreateMaterial(
    Diffuse=swatch,
    Specular=RGB(255, 255, 255),
    Emission=ColourSwatch(SwatchColor=RGB(193, 201, 217)),
    Transparency=0,
    Shine=Slider(30, range=0..100))
number_slider_7 = Slider(11.11, range=0..100)
neg_2 = Negative(Value=number_slider_7)
edges_2 = BrepEdges(Brep=mp_2)  # -> Naked, Interior, NonManifold
preview = CustomPreview(Geometry=mp_2, Material=material)
pline = PolyLine(Closed=False)  # disabled
pline_2 = PolyLine(Closed=False)  # disabled
dom_5 = ConstructDomain(DomainStart=neg_2, DomainEnd=number_slider_7)
merge_12 = Merge(Data1=edges_2.Naked, Data2=edges_2.Interior, Data3=edges_2.NonManifold)
rectangle_2 = Rectangle(Plane=PlaneXY(0, 0, 0), XSize=dom_5, YSize=dom_5, Radius=0)  # -> Rectangle, Length
panel_4 = Panel("""25
25""")  # disabled
merge_13 = Merge(Data1=pline_2, Data2=pline)  # disabled
panel_5 = Panel("4")  # disabled
disc = Discontinuity(Curve=rectangle_2.Rectangle, Level=1)  # -> Points, Parameters
panel_6 = Panel(merge_12)
Z_3 = UnitZ(Factor=panel_5)  # disabled
move_2 = Move(Geometry=merge_13, Motion=Z_3)  # -> Geometry, Transform; disabled
item_6 = ListItem(List=disc.Points, Index=0, Wrap=True)  # -> Item, Item1, Item2, Item3
scale = Scale(Geometry=merge_12, Center=rotate.Geometry, Factor=0.5)  # -> Geometry, Transform
ln_2 = Line(StartPoint=item_6.Item, EndPoint=item_6.Item2)
explode = Explode(Curve=move_2.Geometry, Recursive=True)  # -> Segments, Vertices; disabled
ln_3 = Line(StartPoint=item_6.Item1, EndPoint=item_6.Item3)
dash_2 = DashPattern(Curve=explode.Segments, Pattern=panel_4)  # -> Dashes, Gaps; disabled
number_slider_8 = Slider(4, range=0..100)
merge_14 = Merge(Data1=ln_2, Data2=ln_3)
swatch_3 = ColourSwatch(SwatchColor=RGB(255, 0, 0))
previewlw_2 = CustomPreviewLineweights(Geometry=scale.Geometry, Shader=swatch, Thickness=Slider(2, range=0..10), Absolute=invert(False))
previewlw_3 = CustomPreviewLineweights(Geometry=dash_2.Dashes, Shader=swatch_3, Thickness=number_slider_8, Absolute=invert(False))
previewlw_4 = CustomPreviewLineweights(Geometry=merge_14, Shader=swatch_3, Thickness=number_slider_8, Absolute=invert(False))

# ----
# GRILLA
unit_z = UnitZ(Factor=-10)
point = Point(flatten_tree)
move_3 = Move(Geometry=point, Motion=unit_z)  # -> Geometry, Transform

rectangle_3 = Rectangle(Plane=move_3.Geometry, XSize=dom, YSize=dom, Radius=0)  # -> Rectangle, Length
rotate_2 = Rotate(Geometry=rectangle_3.Rectangle, Angle=degrees("45"), Plane=move_3.Geometry)  # -> Geometry, Transform
disc_2 = Discontinuity(Curve=rotate_2.Geometry, Level=1)  # -> Points, Parameters
item_7 = ListItem(List=disc_2.Points, Index=0, Wrap=True)  # -> Item, Item1, Item2, Item3
ln_4 = Line(StartPoint=item_7.Item1, EndPoint=item_7.Item3)
ln_5 = Line(StartPoint=item_7.Item, EndPoint=item_7.Item2)
merge_15 = Merge(Data1=ln_5, Data2=ln_4)

custom_preview_lineweights = CustomPreviewLineweights(
    Geometry=merge_15,
    Shader=ColourSwatch(SwatchColor=RGB(128, 128, 128)),
    Thickness=Slider(2, range=0..10),
    Absolute=invert(False))

# ==== cluster Cluster
brep = ClusterInput()
brep_2 = Brep(brep)
F = ClusterInput()
volume = Volume(Geometry=brep_2)  # -> Volume, Centroid
S = ClusterInput()
scale = Scale(Geometry=brep_2, Center=volume.Centroid, Factor=F)  # -> Geometry, Transform
pop3d = Populate3D(Region=scale.Geometry, Count="1", Seed=S)
debrep = DeconstructBrep(Brep=brep_2)  # -> Faces, Edges, Vertices
box = Box2Pt(PointA=pop3d, PointB=debrep.Vertices, Plane=PlaneXY(0, 0, 0))
jitter = Jitter(List=box, Jitter=1, Seed=S)  # -> Values, Indices
i = ClusterInput()
split = SplitList(List=jitter.Values, Index=i)  # -> ListA, ListB
A = ClusterOutput(split.ListA)
B = ClusterOutput(split.ListB)
