# Grasshopper definition 20231103_MS_Elbphilharmonie-final.gh (Grasshopper 1.0.7)
# plug-ins: Heteroptera, treesloth01

# ----
# Elbphilharmonie of Hamburg - Herzog & de Meuron
# Morfología de la cubierta
panel = Panel("01 - Curva perimetral")
crv = Curve(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)

panel_2 = Panel("1 Patrón de selección de contexto")
data = Data(28)
panel_3 = Panel("""1 Contexto Seleccionado

2 Contexto Borrado""")
geo = Geometry(crv)
geo_2 = Geometry()

panel_4 = Panel("Curva perimetral")
panel_5 = Panel(panel_2)
data_2 = Data(data)
panel_6 = Panel(panel_3)
geo_3 = Geometry(geo)
geo_4 = Geometry(geo_2)

panel_7 = Panel("02 - Triangulación")
explode = Explode(Curve=geo_3, Recursive=True)  # -> Segments, Vertices
len = Length(Curve=explode.Segments)
division = Division(A=len, B=Slider(26.35, range=0..94))
round = Round(Number=division)  # -> Nearest, Floor, Ceiling
divide = DivideCurve(Curve=explode.Segments, Count=round.Floor, Kinks=False)  # -> flatten(Points), Tangents, Parameters
pcen = PolygonCenter(Polyline=geo_3)  # -> CenterV, CenterE, CenterA
cset = CreateSet(List=divide.Points)  # -> Set, Map
pt = Point(pcen.CenterE)
merge = Merge(Data1=pt, Data2=cset.Set)  # -> flatten(Result)
con = DelaunayEdges(Points=merge, Plane=PlaneXY(0, 0, 0))  # -> Connectivity, Edges
netregion = RegionPerceptive(PointPointTopology=con.Connectivity, Points=merge, BaseOptional=PlaneXY(0, 0, 0), SizeFilterOptional=12, Method=0)  # -> Polylines, Region, RegionTopologyByPointsIndex, NakedLines
project = Project(Geometry=netregion.Polylines, Plane=PlaneXY(0, 0, 0))  # -> Geometry, Transform
area = Area(Geometry=project.Geometry)  # -> Area, Centroid
sort = SortList(Keys=area.Area, ValuesA=netregion.Polylines)  # -> Keys, reverse(ValuesA)
cull_i = CullIndex(List=sort.ValuesA, Indices="0", Wrap=True)

panel_8 = Panel("Triangulación de Delaunay")
panel_9 = Panel("1 Patrón de selección de contexto")
data_3 = Data(28)
panel_10 = Panel("""1 Triangulación de Delaunay

2 Celdas a partir de Delaunay""")
geo_5 = Geometry(cull_i)
geo_6 = Geometry(con.Edges)

data_4 = Data(data)
geo_7 = Geometry(geo)
geo_8 = Geometry(geo_2)

panel_14 = Panel(panel_8)
panel_15 = Panel(panel_9)
data_5 = Data(data_3)
panel_16 = Panel(panel_10)
geo_9 = Geometry(geo_6)
geo_10 = Geometry(geo_5)

# ----
# 03 - Curvatura perimetral de cúpulas
number_slider = Slider(6.89, range=0..10)
graft = GraftTree(Tree=geo_9, IncludeEmptyLists=True, IncludeNullItems=True)
explode_2 = Explode(Curve=geo_10, Recursive=True)  # -> Segments, Vertices
midpt = CurveMiddle(Curve=graft)
Z = UnitZ(Factor=number_slider)
midpt_2 = CurveMiddle(Curve=explode_2.Segments)
neg = Negative(Value=Z)
project_2 = Project(Geometry=midpt_2, Plane=PlaneXY(0, 0, 0))  # -> Geometry, Transform
end = EndPoints(Curve=graft)  # -> Start, End
move = Move(Geometry=midpt, Motion=neg)  # -> Geometry, Transform
graft_2 = GraftTree(Tree=project_2.Geometry, IncludeEmptyLists=True, IncludeNullItems=True)
arc = Arc3Pt(PointA=end.Start, PointB=move.Geometry, PointC=end.End)  # -> flatten(Arc), Plane, Radius
project_3 = Project(Geometry=arc.Arc, Plane=PlaneXY(0, 0, 0))  # -> Geometry, Transform
crv_cp = CurveClosestPoint(Point=graft_2, Curve=project_3.Geometry)  # -> Point, Parameter, Distance
sort_2 = SortList(Keys=crv_cp.Distance, ValuesA=arc.Arc)  # -> Keys, ValuesA
item = ListItem(List=sort_2.ValuesA, Index=0, Wrap=True)
trim = TrimTree(Tree=item, Depth=1)

panel_17 = Panel("Curvatura perimetral de cúpulas")
panel_18 = Panel("1 Patrón de selección de contexto")
data_6 = Data(28)
geo_11 = Geometry(trim)

data_7 = Data(data)
geo_12 = Geometry(geo)
geo_13 = Geometry(geo_2)

data_8 = Data(data_3)
geo_14 = Geometry(geo_6)
geo_15 = Geometry(geo_5)

panel_25 = Panel(panel_17)
panel_26 = Panel(panel_18)
data_9 = Data(data_6)
panel_27 = Panel("1 Arcos principales")
geo_16 = Geometry(geo_11)

# ----
# 04- Curvatura interna de cúpulas
number_slider_2 = Slider(13.05, range=0..30)
number_slider_3 = Slider(0.3, range=0..1)
graft_3 = GraftTree(Tree=geo_15, IncludeEmptyLists=True, IncludeNullItems=True)
area_2 = Area(Geometry=graft_3)  # -> Area, Centroid
Z_2 = UnitZ(Factor=number_slider_2)
neg_2 = Negative(Value=Z_2)
move_2 = Move(Geometry=area_2.Centroid, Motion=neg_2)  # -> Geometry, Transform
disc = Discontinuity(Curve=graft_3, Level=1)  # -> Points, Parameters
pt_2 = Point(move_2.Geometry)
ln = Line(StartPoint=pt_2, EndPoint=disc.Points)
dist = Distance(PointA=pt_2, PointB=disc.Points)
multiplication = Multiplication(A=dist, B=number_slider_3)
vec = Vector(ln)
project_4 = Project(Geometry=vec, Plane=PlaneXY(0, 0, 0))  # -> Geometry, Transform
devec = DeconstructVector(Vector=unitize(project_4.Geometry))  # -> XComponent, YComponent, ZComponent
multiplication_2 = Multiplication(A=dist, B=number_slider_3)
vec_2 = VectorXYZ(XComponent=devec.XComponent, YComponent=devec.YComponent, ZComponent=Slider(1.61, range=0..3))  # -> Vector, Length
amp = Amplitude(Vector=vec_2.Vector, Amplitude=multiplication)
amp_2 = Amplitude(Vector=project_4.Geometry, Amplitude=multiplication_2)
neg_3 = Negative(Value=amp)
bzspan = BezierSpan(StartPoint=pt_2, StartTangent=amp_2, EndPoint=disc.Points, EndTangent=neg_3)  # -> simplify(Curve), Length, Domain

panel_28 = Panel("Curvatura interna de cúpulas")
panel_29 = Panel("1 Patrón de selección de contexto")
data_10 = Data(28)
panel_30 = Panel("""1 Centro de las cúpulas

2 Ejes principales""")
geo_17 = Geometry(pt_2)
geo_18 = Geometry(bzspan.Curve)

data_11 = Data(data)
geo_19 = Geometry(geo)
geo_20 = Geometry(geo_2)

data_12 = Data(data_3)
geo_21 = Geometry(geo_6)
geo_22 = Geometry(geo_5)

data_13 = Data(data_6)
geo_23 = Geometry(geo_11)

panel_40 = Panel(panel_28)
panel_41 = Panel(panel_29)
data_14 = Data(data_10)
panel_42 = Panel(panel_30)
geo_24 = Geometry(geo_18)
geo_25 = Geometry(geo_17)

panel_43 = Panel("05- Curvatura interna secundaria")
crv_2 = Curve(geo_23)
midpt_3 = CurveMiddle(Curve=crv_2)
pt_3 = Point(geo_25)
dist_2 = Distance(PointA=pt_3, PointB=midpt_3)
ln_2 = Line(StartPoint=pt_3, EndPoint=midpt_3)
vec_3 = Vector(ln_2)
project_5 = Project(Geometry=vec_3, Plane=PlaneXY(0, 0, 0))  # -> Geometry, Transform
multiplication_3 = Multiplication(A=dist_2, B=Slider(0.38, range=0..1))
devec_2 = DeconstructVector(Vector=unitize(project_5.Geometry))  # -> XComponent, YComponent, ZComponent
multiplication_4 = Multiplication(A=dist_2, B=Slider(0.37, range=0..1))
amp_3 = Amplitude(Vector=project_5.Geometry, Amplitude=multiplication_3)
vec_4 = VectorXYZ(XComponent=devec_2.XComponent, YComponent=devec_2.YComponent, ZComponent=Slider(1.76, range=0..5))  # -> Vector, Length
amp_4 = Amplitude(Vector=vec_4.Vector, Amplitude=multiplication_4)
neg_4 = Negative(Value=amp_4)
bzspan_2 = BezierSpan(StartPoint=pt_3, StartTangent=amp_3, EndPoint=midpt_3, EndTangent=neg_4)  # -> reparameterize(simplify(Curve)), Length, Domain

panel_44 = Panel("Curvatura interna secundaria")
panel_45 = Panel("1 Patrón de selección de contexto")
data_15 = Data(28)
geo_26 = Geometry(bzspan_2.Curve)

panel_46 = Panel(panel_44)
panel_47 = Panel(panel_45)
data_16 = Data(data_15)
panel_48 = Panel("1 Ejes secundarios")
geo_27 = Geometry(geo_26)

data_17 = Data(data_6)
geo_28 = Geometry(geo_11)

data_18 = Data(data_10)
geo_29 = Geometry(geo_17)
geo_30 = Geometry(geo_18)

data_19 = Data(data)
geo_31 = Geometry(geo_2)
geo_32 = Geometry(geo)

data_20 = Data(data_3)
geo_33 = Geometry(geo_6)
geo_34 = Geometry(geo_5)

# ----
# Cotas de nivel de cúpulas
crv_3 = Curve(geo_30)
weave = Weave(Pattern=[0, 1], Stream0=crv_3, Stream1=geo_27, NullGaps=False)
Z_3 = UnitZ(Factor=Slider(0.06, range=0..10))
Z_4 = UnitZ(Factor=Slider(2.1, range=0..10))
move_3 = Move(Geometry=geo_29, Motion=Z_3)  # -> simplify(Geometry), Transform
move_4 = Move(Geometry=geo_29, Motion=Z_4)  # -> simplify(Geometry), Transform
graft_4 = GraftTree(Tree=move_3.Geometry, IncludeEmptyLists=True, IncludeNullItems=True)
graft_5 = GraftTree(Tree=move_4.Geometry, IncludeEmptyLists=True, IncludeNullItems=True)
propagate = PropagateAncestor(Data=graft_4, Ancestors=weave)  # -> UpdatedData, PropagatedAncestors, BarrenAncestors, Orhpans
pcx = CurvePlane(Curve=propagate.PropagatedAncestors, Plane=graft_4)  # -> Points, ParamsC, ParamsP
pcx_2 = CurvePlane(Curve=propagate.PropagatedAncestors, Plane=graft_5)  # -> Points, ParamsC, ParamsP
trim_2 = TrimTree(Tree=pcx.Points, Depth=1)
trim_3 = TrimTree(Tree=pcx_2.Points, Depth=1)
intcrv = Interpolate(Vertices=trim_2, Degree=3, Periodic=invert(False), KnotStyle=1)  # -> simplify(Curve), Length, Domain
intcrv_2 = Interpolate(Vertices=trim_3, Degree=3, Periodic=invert(False), KnotStyle=1)  # -> simplify(Curve), Length, Domain
dispatch = Dispatch(List=trim_2, DispatchPattern=[True, False])  # -> ListA, ListB
dispatch_2 = Dispatch(List=trim_3, DispatchPattern=[True, False])  # -> ListA, ListB
pt_4 = Point(simplify(dispatch.ListA))
pt_5 = Point(simplify(dispatch_2.ListA))
crv_cp_2 = CurveClosestPoint(Point=pt_4, Curve=intcrv.Curve)  # -> Point, Parameter, Distance
crv_cp_3 = CurveClosestPoint(Point=pt_5, Curve=intcrv_2.Curve)  # -> Point, Parameter, Distance
shatter = Shatter(Curve=intcrv.Curve, Parameters=crv_cp_2.Parameter)  # -> reparameterize(Segments)
shatter_2 = Shatter(Curve=intcrv_2.Curve, Parameters=crv_cp_3.Parameter)  # -> reparameterize(Segments)
graft_6 = GraftTree(Tree=shatter, IncludeEmptyLists=True, IncludeNullItems=True)  # -> simplify(Tree)
graft_7 = GraftTree(Tree=shatter_2, IncludeEmptyLists=True, IncludeNullItems=True)  # -> simplify(Tree)

panel_61 = Panel("1 Patrón de selección de contexto")
data_21 = Data(28)
panel_62 = Panel("""1 Cota inferior

02 Cota intermedia""")
geo_35 = Geometry(graft_6)
geo_36 = Geometry(graft_7)

data_22 = Data(data_15)
geo_37 = Geometry(geo_26)

data_23 = Data(data)
geo_38 = Geometry(geo)
geo_39 = Geometry(geo_2)

data_24 = Data(data_3)
geo_40 = Geometry(geo_6)
geo_41 = Geometry(geo_5)

data_25 = Data(data_6)
geo_42 = Geometry(geo_11)

data_26 = Data(data_10)
geo_43 = Geometry(geo_18)
geo_44 = Geometry(geo_17)

panel_78 = Panel("Cotas internas")
panel_79 = Panel(panel_61)
data_27 = Data(data_21)
panel_80 = Panel(panel_62)
geo_45 = Geometry(geo_35)
geo_46 = Geometry(geo_36)

panel_81 = Panel("Superficie final")
graft_8 = GraftTree(Tree=geo_42, IncludeEmptyLists=True, IncludeNullItems=True)  # -> simplify(Tree)
graft_9 = GraftTree(Tree=geo_43, IncludeEmptyLists=True, IncludeNullItems=True)
merge_2 = Merge(Data1=graft_8, Data2=geo_46, Data3=geo_45)
dup = DuplicateData(Data=graft_9, Number=2, Order=True)  # -> simplify(Data)
trim_4 = TrimTree(Tree=dup, Depth=1)
shift = ShiftList(List=trim_4, Shift=1, Wrap=True)
partition = PartitionList(List=shift, Size="2")  # -> simplify(Chunks)
shift_2 = ShiftList(List=geo_37, Shift=Slider(3, range=0..10), Wrap=True)
graft_10 = GraftTree(Tree=shift_2, IncludeEmptyLists=True, IncludeNullItems=True)
weave_2 = Weave(Pattern=[0, 1], Stream0=partition, Stream1=graft_10, NullGaps=False)
netsurf = NetworkSurface(CurvesU=weave_2, CurvesV=merge_2, Continuity=Slider(1, range=0..3))

data_28 = Data(28)
geo_47 = Geometry(netsurf)

data_29 = Data(data_15)
geo_48 = Geometry(geo_26)

data_30 = Data(data)
geo_49 = Geometry(geo)
geo_50 = Geometry(geo_2)

data_31 = Data(data_3)
geo_51 = Geometry(geo_6)
geo_52 = Geometry(geo_5)

data_32 = Data(data_6)
geo_53 = Geometry(geo_11)

data_33 = Data(data_10)
geo_54 = Geometry(geo_17)
geo_55 = Geometry(geo_18)

data_34 = Data(data_21)
geo_56 = Geometry(geo_35)
geo_57 = Geometry(geo_36)

panel_100 = Panel("Ejes internos principales")

panel_102 = Panel("1 Patrón de selección de contexto")
data_35 = Data(data_28)
panel_103 = Panel("1 Superficies")
geo_58 = Geometry(geo_47)
