# Grasshopper definition Roof.gh (Grasshopper 1.0.7)
# plug-ins: Heteroptera, treesloth01

# ----
# Esferas
number_slider = Slider(26.35, range=0..94)
crv = Curve(<curve referenced from the Rhino model>)
explode = Explode(Curve=crv, Recursive=True)  # -> Segments, Vertices
len = Length(Curve=explode.Segments)
division = Division(A=len, B=number_slider)
round = Round(Number=division)  # -> Nearest, Floor, Ceiling
divide = DivideCurve(Curve=explode.Segments, Count=round.Floor, Kinks=False)  # -> flatten(Points), Tangents, Parameters
pcen = PolygonCenter(Polyline=crv)  # -> CenterV, CenterE, CenterA
cset = CreateSet(List=divide.Points)  # -> Set, Map
pt = Point(pcen.CenterE)
merge = Merge(Data1=pt, Data2=cset.Set)  # -> flatten(Result)
con = DelaunayEdges(Points=merge, Plane=PlaneXY(0, 0, 0))  # -> Connectivity, Edges
netregion = RegionPerceptive(PointPointTopology=con.Connectivity, Points=merge, BaseOptional=PlaneXY(0, 0, 0), SizeFilterOptional=12, Method=0)  # -> Polylines, Region, RegionTopologyByPointsIndex, NakedLines
project = Project(Geometry=netregion.Polylines, Plane=PlaneXY(0, 0, 0))  # -> Geometry, Transform
area = Area(Geometry=project.Geometry)  # -> Area, Centroid
sort = SortList(Keys=area.Area, ValuesA=netregion.Polylines)  # -> Keys, reverse(ValuesA)
cull_i = CullIndex(List=sort.ValuesA, Indices="0", Wrap=True)
crv_2 = Curve(cull_i)
graft = GraftTree(Tree=crv_2, IncludeEmptyLists=True, IncludeNullItems=True)
Z = UnitZ(Factor=Slider(12.6, range=0..50))
multiplication = Multiplication(A=Z, B=Slider(2.5, range=0..10))
area_2 = Area(Geometry=graft)  # -> Area, Centroid
neg = Negative(Value=Z)
disc = Discontinuity(Curve=graft, Level=1)  # -> Points, Parameters
item = ListItem(List=disc.Points, Index=0, Wrap=True)  # -> Item, Item1, Item2
move = Move(Geometry=area_2.Centroid, Motion=neg)  # -> Geometry, Transform
neg_2 = Negative(Value=multiplication)
sph4pt = Sphere4Pt(Point1=item.Item, Point2=item.Item1, Point3=item.Item2, Point4=move.Geometry)  # -> Center, Radius, Sphere
move_2 = Move(Geometry=graft, Motion=neg_2)  # -> Geometry, Transform
extr = Extrude(Base=move_2.Geometry, Direction=multiplication)
cap = CapHoles(Brep=extr)
split = SplitBrep(Brep=sph4pt.Sphere, Cutter=cap)
area_3 = Area(Geometry=split)  # -> Area, Centroid
brepinc = PointInBrep(Brep=cap, Point=area_3.Centroid, Strict=False)
cull = CullPattern(List=split, CullPattern=brepinc)

# ----
# Arcos y Edge Surface
number_slider_2 = Slider(26.35, range=0..94)
crv_3 = Curve(<curve referenced from the Rhino model>)
explode_2 = Explode(Curve=crv_3, Recursive=True)  # -> Segments, Vertices
len_2 = Length(Curve=explode_2.Segments)
division_2 = Division(A=len_2, B=number_slider_2)
round_2 = Round(Number=division_2)  # -> Nearest, Floor, Ceiling
divide_2 = DivideCurve(Curve=explode_2.Segments, Count=round_2.Floor, Kinks=False)  # -> flatten(Points), Tangents, Parameters
pcen_2 = PolygonCenter(Polyline=crv_3)  # -> CenterV, CenterE, CenterA
cset_2 = CreateSet(List=divide_2.Points)  # -> Set, Map
pt_2 = Point(pcen_2.CenterE)
merge_2 = Merge(Data1=pt_2, Data2=cset_2.Set)  # -> flatten(Result)
con_2 = DelaunayEdges(Points=merge_2, Plane=PlaneXY(0, 0, 0))  # -> Connectivity, Edges
netregion_2 = RegionPerceptive(PointPointTopology=con_2.Connectivity, Points=merge_2, BaseOptional=PlaneXY(0, 0, 0), SizeFilterOptional=12, Method=0)  # -> Polylines, Region, RegionTopologyByPointsIndex, NakedLines
graft_2 = GraftTree(Tree=con_2.Edges, IncludeEmptyLists=True, IncludeNullItems=True)
midpt = CurveMiddle(Curve=graft_2)
Z_2 = UnitZ(Factor=Slider(6.6, range=0..10))
project_2 = Project(Geometry=netregion_2.Polylines, Plane=PlaneXY(0, 0, 0))  # -> Geometry, Transform
neg_3 = Negative(Value=Z_2)
area_4 = Area(Geometry=project_2.Geometry)  # -> Area, Centroid
move_3 = Move(Geometry=midpt, Motion=neg_3)  # -> Geometry, Transform
end = EndPoints(Curve=graft_2)  # -> Start, End
sort_2 = SortList(Keys=area_4.Area, ValuesA=netregion_2.Polylines)  # -> Keys, reverse(ValuesA)
arc = Arc3Pt(PointA=end.Start, PointB=move_3.Geometry, PointC=end.End)  # -> flatten(Arc), Plane, Radius
cull_i_2 = CullIndex(List=sort_2.ValuesA, Indices="0", Wrap=True)
explode_3 = Explode(Curve=cull_i_2, Recursive=True)  # -> Segments, Vertices
midpt_2 = CurveMiddle(Curve=explode_3.Segments)
project_3 = Project(Geometry=midpt_2, Plane=PlaneXY(0, 0, 0))  # -> Geometry, Transform
project_4 = Project(Geometry=arc.Arc, Plane=PlaneXY(0, 0, 0))  # -> Geometry, Transform
graft_3 = GraftTree(Tree=project_3.Geometry, IncludeEmptyLists=True, IncludeNullItems=True)
crv_cp = CurveClosestPoint(Point=graft_3, Curve=project_4.Geometry)  # -> Point, Parameter, Distance
sort_3 = SortList(Keys=crv_cp.Distance, ValuesA=arc.Arc)  # -> Keys, ValuesA
item_2 = ListItem(List=sort_3.ValuesA, Index=0, Wrap=True)
trim = TrimTree(Tree=item_2, Depth=1)
item_3 = ListItem(List=trim, Index=0, Wrap=True)  # -> Item, Item1, Item2
edgesrf = EdgeSurface(CurveA=item_3.Item, CurveB=item_3.Item1, CurveC=item_3.Item2)

# ----
# Arcos y Sub-D
number_slider_3 = Slider(26.35, range=0..94)
crv_4 = Curve(<curve referenced from the Rhino model>)
explode_4 = Explode(Curve=crv_4, Recursive=True)  # -> Segments, Vertices
len_3 = Length(Curve=explode_4.Segments)
division_3 = Division(A=len_3, B=number_slider_3)
round_3 = Round(Number=division_3)  # -> Nearest, Floor, Ceiling
divide_3 = DivideCurve(Curve=explode_4.Segments, Count=round_3.Floor, Kinks=False)  # -> flatten(Points), Tangents, Parameters
pcen_3 = PolygonCenter(Polyline=crv_4)  # -> CenterV, CenterE, CenterA
cset_3 = CreateSet(List=divide_3.Points)  # -> Set, Map
pt_3 = Point(pcen_3.CenterE)
merge_3 = Merge(Data1=pt_3, Data2=cset_3.Set)  # -> flatten(Result)
con_3 = DelaunayEdges(Points=merge_3, Plane=PlaneXY(0, 0, 0))  # -> Connectivity, Edges
netregion_3 = RegionPerceptive(PointPointTopology=con_3.Connectivity, Points=merge_3, BaseOptional=PlaneXY(0, 0, 0), SizeFilterOptional=12, Method=0)  # -> Polylines, Region, RegionTopologyByPointsIndex, NakedLines
graft_4 = GraftTree(Tree=con_3.Edges, IncludeEmptyLists=True, IncludeNullItems=True)
midpt_3 = CurveMiddle(Curve=graft_4)
Z_3 = UnitZ(Factor=Slider(6.6, range=0..10))
project_5 = Project(Geometry=netregion_3.Polylines, Plane=PlaneXY(0, 0, 0))  # -> Geometry, Transform
neg_4 = Negative(Value=Z_3)
area_5 = Area(Geometry=project_5.Geometry)  # -> Area, Centroid
move_4 = Move(Geometry=midpt_3, Motion=neg_4)  # -> Geometry, Transform
end_2 = EndPoints(Curve=graft_4)  # -> Start, End
sort_4 = SortList(Keys=area_5.Area, ValuesA=netregion_3.Polylines)  # -> Keys, reverse(ValuesA)
arc_2 = Arc3Pt(PointA=end_2.Start, PointB=move_4.Geometry, PointC=end_2.End)  # -> flatten(Arc), Plane, Radius
cull_i_3 = CullIndex(List=sort_4.ValuesA, Indices="0", Wrap=True)
graft_5 = GraftTree(Tree=cull_i_3, IncludeEmptyLists=True, IncludeNullItems=True)
explode_5 = Explode(Curve=cull_i_3, Recursive=True)  # -> Segments, Vertices
midpt_4 = CurveMiddle(Curve=explode_5.Segments)
project_6 = Project(Geometry=midpt_4, Plane=PlaneXY(0, 0, 0))  # -> Geometry, Transform
project_7 = Project(Geometry=arc_2.Arc, Plane=PlaneXY(0, 0, 0))  # -> Geometry, Transform
graft_6 = GraftTree(Tree=project_6.Geometry, IncludeEmptyLists=True, IncludeNullItems=True)
Z_4 = UnitZ(Factor=Slider(11.11, range=0..30))
crv_cp_2 = CurveClosestPoint(Point=graft_6, Curve=project_7.Geometry)  # -> Point, Parameter, Distance
sort_5 = SortList(Keys=crv_cp_2.Distance, ValuesA=arc_2.Arc)  # -> Keys, ValuesA
area_6 = Area(Geometry=graft_5)  # -> Area, Centroid
disc_2 = Discontinuity(Curve=graft_5, Level=1)  # -> Points, Parameters
neg_5 = Negative(Value=Z_4)
item_4 = ListItem(List=sort_5.ValuesA, Index=0, Wrap=True)
move_5 = Move(Geometry=area_6.Centroid, Motion=neg_5)  # -> simplify(Geometry), Transform
trim_2 = TrimTree(Tree=item_4, Depth=1)
midpt_5 = CurveMiddle(Curve=trim_2)
weave = Weave(Pattern=[0, 1], Stream0=midpt_5, Stream1=disc_2.Points, NullGaps=False)  # -> simplify(Weave)
merge_4 = Merge(Data1=weave, Data2=move_5.Geometry)
del = DelaunayMesh(Points=merge_4, Plane=PlaneXY(0, 0, 0))  # -> flatten(Mesh)
mjoin = MeshJoin(Meshes=del)
subdmesh = SubDFromMesh(Mesh=mjoin, Creases=2, Corners=2, Interpolate=False)

# ----
# Arcos y Network Srf con eje medio
number_slider_4 = Slider(26.35, range=0..94)
crv_5 = Curve(<curve referenced from the Rhino model>)
explode_6 = Explode(Curve=crv_5, Recursive=True)  # -> Segments, Vertices
len_4 = Length(Curve=explode_6.Segments)
division_4 = Division(A=len_4, B=number_slider_4)
round_4 = Round(Number=division_4)  # -> Nearest, Floor, Ceiling
divide_4 = DivideCurve(Curve=explode_6.Segments, Count=round_4.Floor, Kinks=False)  # -> flatten(Points), Tangents, Parameters
pcen_4 = PolygonCenter(Polyline=crv_5)  # -> CenterV, CenterE, CenterA
cset_4 = CreateSet(List=divide_4.Points)  # -> Set, Map
pt_4 = Point(pcen_4.CenterE)
merge_5 = Merge(Data1=pt_4, Data2=cset_4.Set)  # -> flatten(Result)
con_4 = DelaunayEdges(Points=merge_5, Plane=PlaneXY(0, 0, 0))  # -> Connectivity, Edges
netregion_4 = RegionPerceptive(PointPointTopology=con_4.Connectivity, Points=merge_5, BaseOptional=PlaneXY(0, 0, 0), SizeFilterOptional=12, Method=0)  # -> Polylines, Region, RegionTopologyByPointsIndex, NakedLines
graft_7 = GraftTree(Tree=con_4.Edges, IncludeEmptyLists=True, IncludeNullItems=True)
midpt_6 = CurveMiddle(Curve=graft_7)
Z_5 = UnitZ(Factor=Slider(6.6, range=0..10))
project_8 = Project(Geometry=netregion_4.Polylines, Plane=PlaneXY(0, 0, 0))  # -> Geometry, Transform
neg_6 = Negative(Value=Z_5)
area_7 = Area(Geometry=project_8.Geometry)  # -> Area, Centroid
move_6 = Move(Geometry=midpt_6, Motion=neg_6)  # -> Geometry, Transform
end_3 = EndPoints(Curve=graft_7)  # -> Start, End
sort_6 = SortList(Keys=area_7.Area, ValuesA=netregion_4.Polylines)  # -> Keys, reverse(ValuesA)
arc_3 = Arc3Pt(PointA=end_3.Start, PointB=move_6.Geometry, PointC=end_3.End)  # -> flatten(Arc), Plane, Radius
cull_i_4 = CullIndex(List=sort_6.ValuesA, Indices="0", Wrap=True)
graft_8 = GraftTree(Tree=cull_i_4, IncludeEmptyLists=True, IncludeNullItems=True)
explode_7 = Explode(Curve=cull_i_4, Recursive=True)  # -> Segments, Vertices
midpt_7 = CurveMiddle(Curve=explode_7.Segments)
project_9 = Project(Geometry=midpt_7, Plane=PlaneXY(0, 0, 0))  # -> Geometry, Transform
project_10 = Project(Geometry=arc_3.Arc, Plane=PlaneXY(0, 0, 0))  # -> Geometry, Transform
area_8 = Area(Geometry=graft_8)  # -> Area, Centroid
Z_6 = UnitZ(Factor=Slider(12.6, range=0..30))
graft_9 = GraftTree(Tree=project_9.Geometry, IncludeEmptyLists=True, IncludeNullItems=True)
neg_7 = Negative(Value=Z_6)
crv_cp_3 = CurveClosestPoint(Point=graft_9, Curve=project_10.Geometry)  # -> Point, Parameter, Distance
sort_7 = SortList(Keys=crv_cp_3.Distance, ValuesA=arc_3.Arc)  # -> Keys, ValuesA
move_7 = Move(Geometry=area_8.Centroid, Motion=neg_7)  # -> Geometry, Transform
disc_3 = Discontinuity(Curve=graft_8, Level=1)  # -> Points, Parameters
item_5 = ListItem(List=sort_7.ValuesA, Index=0, Wrap=True)
number_slider_5 = Slider(0.3, range=0..1)
pt_5 = Point(move_7.Geometry)
trim_3 = TrimTree(Tree=item_5, Depth=1)
dist = Distance(PointA=pt_5, PointB=disc_3.Points)
ln = Line(StartPoint=pt_5, EndPoint=disc_3.Points)
vec = Vector(ln)
join = JoinCurves(Curves=trim_3, Preserve=False)
project_11 = Project(Geometry=vec, Plane=PlaneXY(0, 0, 0))  # -> Geometry, Transform
multiplication_2 = Multiplication(A=dist, B=number_slider_5)
devec = DeconstructVector(Vector=unitize(project_11.Geometry))  # -> XComponent, YComponent, ZComponent
multiplication_3 = Multiplication(A=dist, B=number_slider_5)
disc_4 = Discontinuity(Curve=join, Level=1)  # -> Points, Parameters
amp = Amplitude(Vector=project_11.Geometry, Amplitude=multiplication_2)
vec_2 = VectorXYZ(XComponent=devec.XComponent, YComponent=devec.YComponent, ZComponent=Slider(1.61, range=0..3))  # -> Vector, Length
amp_2 = Amplitude(Vector=vec_2.Vector, Amplitude=multiplication_3)
eval = EvaluateCurve(Curve=join, Parameter=disc_4.Parameters)  # -> Point, Tangent, Angle
neg_8 = Negative(Value=amp_2)
bzspan = BezierSpan(StartPoint=pt_5, StartTangent=amp, EndPoint=disc_3.Points, EndTangent=neg_8)  # -> Curve, Length, Domain
graft_10 = GraftTree(Tree=bzspan.Curve, IncludeEmptyLists=True, IncludeNullItems=True)
dup = DuplicateData(Data=graft_10, Number=2, Order=True)  # -> simplify(Data)
trim_4 = TrimTree(Tree=dup, Depth=1)
shift = ShiftList(List=trim_3, Shift=Slider(0, range=0..100), Wrap=True)
shift_2 = ShiftList(List=trim_4, Shift=1, Wrap=True)
midpt_8 = CurveMiddle(Curve=shift)
pt_6 = Point(pt_5)
graft_11 = GraftTree(Tree=shift, IncludeEmptyLists=True, IncludeNullItems=True)  # -> simplify(Tree)
partition = PartitionList(List=shift_2, Size="2")  # -> simplify(Chunks)
dist_2 = Distance(PointA=pt_6, PointB=midpt_8)
ln_2 = Line(StartPoint=pt_6, EndPoint=midpt_8)
vec_3 = Vector(ln_2)
merge_6 = Merge(Data1=graft_11, Data2=partition)
project_12 = Project(Geometry=vec_3, Plane=PlaneXY(0, 0, 0))  # -> Geometry, Transform
multiplication_4 = Multiplication(A=dist_2, B=Slider(0.28, range=0..1))
devec_2 = DeconstructVector(Vector=unitize(project_12.Geometry))  # -> XComponent, YComponent, ZComponent
multiplication_5 = Multiplication(A=dist_2, B=Slider(0.42, range=0..1))
amp_3 = Amplitude(Vector=project_12.Geometry, Amplitude=multiplication_4)
vec_4 = VectorXYZ(XComponent=devec_2.XComponent, YComponent=devec_2.YComponent, ZComponent=Slider(3, range=0..5))  # -> Vector, Length
amp_4 = Amplitude(Vector=vec_4.Vector, Amplitude=multiplication_5)
neg_9 = Negative(Value=amp_4)
bzspan_2 = BezierSpan(StartPoint=pt_6, StartTangent=amp_3, EndPoint=midpt_8, EndTangent=neg_9)  # -> reparameterize(Curve), Length, Domain
eval_2 = EvaluateCurve(Curve=bzspan_2.Curve, Parameter=Slider(0.11, range=0..1))  # -> Point, Tangent, Angle
Z_7 = UnitZ(Factor=Slider(0.11, range=0..1))
crv_6 = Curve(partition)
move_8 = Move(Geometry=pt_6, Motion=Z_7)  # -> simplify(Geometry), Transform
propagate = PropagateAncestor(Data=crv_6, Ancestors=move_8.Geometry)  # -> UpdatedData, PropagatedAncestors, BarrenAncestors, Orhpans
pcx = CurvePlane(Curve=crv_6, Plane=propagate.PropagatedAncestors)  # -> Points, ParamsC, ParamsP
graft_12 = GraftTree(Tree=eval_2.Point, IncludeEmptyLists=True, IncludeNullItems=True)
trim_5 = TrimTree(Tree=pcx.Points, Depth=1)
item_6 = ListItem(List=trim_5, Index=0, Wrap=True)  # -> Item, Item1
arc_4 = Arc3Pt(PointA=item_6.Item, PointB=graft_12, PointC=item_6.Item1)  # -> simplify(Arc), Plane, Radius
merge_7 = Merge(Data1=graft_11, Data2=arc_4.Arc)
netsurf = NetworkSurface(CurvesU=partition, CurvesV=merge_7, Continuity=Slider(2, range=0..3))
Z_8 = UnitZ(Factor=1)
contour = Contour(Shape=netsurf, Point=Point(0, 0, 0), Direction=Z_8, Distance=Slider(1, range=0..1))

crv_7 = Curve(<curve referenced from the Rhino model>)
explode_8 = Explode(Curve=crv_7, Recursive=True)  # -> Segments, Vertices
len_5 = Length(Curve=explode_8.Segments)
division_5 = Division(A=len_5, B=Slider(26.35, range=0..94))
round_5 = Round(Number=division_5)  # -> Nearest, Floor, Ceiling
divide_5 = DivideCurve(Curve=explode_8.Segments, Count=round_5.Floor, Kinks=False)  # -> flatten(Points), Tangents, Parameters
pcen_5 = PolygonCenter(Polyline=crv_7)  # -> CenterV, CenterE, CenterA
cset_5 = CreateSet(List=divide_5.Points)  # -> Set, Map
pt_7 = Point(pcen_5.CenterE)
merge_8 = Merge(Data1=pt_7, Data2=cset_5.Set)  # -> flatten(Result)
con_5 = DelaunayEdges(Points=merge_8, Plane=PlaneXY(0, 0, 0))  # -> Connectivity, Edges
netregion_5 = RegionPerceptive(PointPointTopology=con_5.Connectivity, Points=merge_8, BaseOptional=PlaneXY(0, 0, 0), SizeFilterOptional=12, Method=0)  # -> Polylines, Region, RegionTopologyByPointsIndex, NakedLines
graft_13 = GraftTree(Tree=con_5.Edges, IncludeEmptyLists=True, IncludeNullItems=True)
midpt_9 = CurveMiddle(Curve=graft_13)
Z_9 = UnitZ(Factor=Slider(6.6, range=0..10))
project_13 = Project(Geometry=netregion_5.Polylines, Plane=PlaneXY(0, 0, 0))  # -> Geometry, Transform
neg_10 = Negative(Value=Z_9)
area_9 = Area(Geometry=project_13.Geometry)  # -> Area, Centroid
move_9 = Move(Geometry=midpt_9, Motion=neg_10)  # -> Geometry, Transform
end_4 = EndPoints(Curve=graft_13)  # -> Start, End
sort_8 = SortList(Keys=area_9.Area, ValuesA=netregion_5.Polylines)  # -> Keys, reverse(ValuesA)
arc_5 = Arc3Pt(PointA=end_4.Start, PointB=move_9.Geometry, PointC=end_4.End)  # -> flatten(Arc), Plane, Radius
cull_i_5 = CullIndex(List=sort_8.ValuesA, Indices="0", Wrap=True)
graft_14 = GraftTree(Tree=cull_i_5, IncludeEmptyLists=True, IncludeNullItems=True)
explode_9 = Explode(Curve=cull_i_5, Recursive=True)  # -> Segments, Vertices
midpt_10 = CurveMiddle(Curve=explode_9.Segments)
project_14 = Project(Geometry=midpt_10, Plane=PlaneXY(0, 0, 0))  # -> Geometry, Transform
project_15 = Project(Geometry=arc_5.Arc, Plane=PlaneXY(0, 0, 0))  # -> Geometry, Transform
area_10 = Area(Geometry=graft_14)  # -> Area, Centroid
Z_10 = UnitZ(Factor=Slider(12.6, range=0..30))
graft_15 = GraftTree(Tree=project_14.Geometry, IncludeEmptyLists=True, IncludeNullItems=True)
neg_11 = Negative(Value=Z_10)
crv_cp_4 = CurveClosestPoint(Point=graft_15, Curve=project_15.Geometry)  # -> Point, Parameter, Distance
sort_9 = SortList(Keys=crv_cp_4.Distance, ValuesA=arc_5.Arc)  # -> Keys, ValuesA
move_10 = Move(Geometry=area_10.Centroid, Motion=neg_11)  # -> Geometry, Transform
disc_5 = Discontinuity(Curve=graft_14, Level=1)  # -> Points, Parameters
item_7 = ListItem(List=sort_9.ValuesA, Index=0, Wrap=True)
number_slider_6 = Slider(0.3, range=0..1)
pt_8 = Point(move_10.Geometry)
trim_6 = TrimTree(Tree=item_7, Depth=1)
dist_3 = Distance(PointA=pt_8, PointB=disc_5.Points)
ln_3 = Line(StartPoint=pt_8, EndPoint=disc_5.Points)
vec_5 = Vector(ln_3)
join_2 = JoinCurves(Curves=trim_6, Preserve=False)
project_16 = Project(Geometry=vec_5, Plane=PlaneXY(0, 0, 0))  # -> Geometry, Transform
multiplication_6 = Multiplication(A=dist_3, B=number_slider_6)
devec_3 = DeconstructVector(Vector=unitize(project_16.Geometry))  # -> XComponent, YComponent, ZComponent
multiplication_7 = Multiplication(A=dist_3, B=number_slider_6)
disc_6 = Discontinuity(Curve=join_2, Level=1)  # -> Points, Parameters
amp_5 = Amplitude(Vector=project_16.Geometry, Amplitude=multiplication_6)
vec_6 = VectorXYZ(XComponent=devec_3.XComponent, YComponent=devec_3.YComponent, ZComponent=Slider(1.61, range=0..3))  # -> Vector, Length
amp_6 = Amplitude(Vector=vec_6.Vector, Amplitude=multiplication_7)
eval_3 = EvaluateCurve(Curve=join_2, Parameter=disc_6.Parameters)  # -> Point, Tangent, Angle
neg_12 = Negative(Value=amp_6)
bzspan_3 = BezierSpan(StartPoint=pt_8, StartTangent=amp_5, EndPoint=disc_5.Points, EndTangent=neg_12)  # -> simplify(Curve), Length, Domain
graft_16 = GraftTree(Tree=bzspan_3.Curve, IncludeEmptyLists=True, IncludeNullItems=True)
dup_2 = DuplicateData(Data=graft_16, Number=2, Order=True)  # -> simplify(Data)
trim_7 = TrimTree(Tree=dup_2, Depth=1)
shift_3 = ShiftList(List=trim_6, Shift=Slider(0, range=0..100), Wrap=True)
shift_4 = ShiftList(List=trim_7, Shift=1, Wrap=True)
midpt_11 = CurveMiddle(Curve=shift_3)
pt_9 = Point(pt_8)
graft_17 = GraftTree(Tree=shift_3, IncludeEmptyLists=True, IncludeNullItems=True)  # -> simplify(Tree)
partition_2 = PartitionList(List=shift_4, Size="2")  # -> simplify(Chunks)
dist_4 = Distance(PointA=pt_9, PointB=midpt_11)
ln_4 = Line(StartPoint=pt_9, EndPoint=midpt_11)
vec_7 = Vector(ln_4)
project_17 = Project(Geometry=vec_7, Plane=PlaneXY(0, 0, 0))  # -> Geometry, Transform
multiplication_8 = Multiplication(A=dist_4, B=Slider(0.32, range=0..1))
devec_4 = DeconstructVector(Vector=unitize(project_17.Geometry))  # -> XComponent, YComponent, ZComponent
Z_11 = UnitZ(Factor=Slider(0.06, range=0..10))
Z_12 = UnitZ(Factor=Slider(3.47, range=0..10))
multiplication_9 = Multiplication(A=dist_4, B=Slider(0.37, range=0..1))
crv_8 = Curve(bzspan_3.Curve)
amp_7 = Amplitude(Vector=project_17.Geometry, Amplitude=multiplication_8)
move_11 = Move(Geometry=pt_8, Motion=Z_11)  # -> simplify(Geometry), Transform
move_12 = Move(Geometry=pt_8, Motion=Z_12)  # -> simplify(Geometry), Transform
vec_8 = VectorXYZ(XComponent=devec_4.XComponent, YComponent=devec_4.YComponent, ZComponent=Slider(1.76, range=0..5))  # -> Vector, Length
amp_8 = Amplitude(Vector=vec_8.Vector, Amplitude=multiplication_9)
graft_18 = GraftTree(Tree=move_11.Geometry, IncludeEmptyLists=True, IncludeNullItems=True)
graft_19 = GraftTree(Tree=move_12.Geometry, IncludeEmptyLists=True, IncludeNullItems=True)
neg_13 = Negative(Value=amp_8)
bzspan_4 = BezierSpan(StartPoint=pt_9, StartTangent=amp_7, EndPoint=midpt_11, EndTangent=neg_13)  # -> reparameterize(simplify(Curve)), Length, Domain
weave_2 = Weave(Pattern=[0, 1], Stream0=crv_8, Stream1=bzspan_4.Curve, NullGaps=False)
propagate_2 = PropagateAncestor(Data=graft_18, Ancestors=weave_2)  # -> UpdatedData, PropagatedAncestors, BarrenAncestors, Orhpans
pcx_2 = CurvePlane(Curve=propagate_2.PropagatedAncestors, Plane=graft_18)  # -> Points, ParamsC, ParamsP
pcx_3 = CurvePlane(Curve=propagate_2.PropagatedAncestors, Plane=graft_19)  # -> Points, ParamsC, ParamsP
shift_5 = ShiftList(List=bzspan_4.Curve, Shift=Slider(3, range=0..10), Wrap=True)
graft_20 = GraftTree(Tree=shift_5, IncludeEmptyLists=True, IncludeNullItems=True)
trim_8 = TrimTree(Tree=pcx_2.Points, Depth=1)
trim_9 = TrimTree(Tree=pcx_3.Points, Depth=1)
weave_3 = Weave(Pattern=[0, 1], Stream0=partition_2, Stream1=graft_20, NullGaps=False)
intcrv = Interpolate(Vertices=trim_8, Degree=3, Periodic=invert(False), KnotStyle=1)  # -> simplify(Curve), Length, Domain
intcrv_2 = Interpolate(Vertices=trim_9, Degree=3, Periodic=invert(False), KnotStyle=1)  # -> simplify(Curve), Length, Domain
dispatch = Dispatch(List=trim_8, DispatchPattern=[True, False])  # -> ListA, ListB
dispatch_2 = Dispatch(List=trim_9, DispatchPattern=[True, False])  # -> ListA, ListB
pt_10 = Point(simplify(dispatch.ListA))
pt_11 = Point(simplify(dispatch_2.ListA))
pt_12 = Point(simplify(dispatch_2.ListB))
crv_cp_5 = CurveClosestPoint(Point=pt_10, Curve=intcrv.Curve)  # -> Point, Parameter, Distance
crv_cp_6 = CurveClosestPoint(Point=pt_11, Curve=intcrv_2.Curve)  # -> Point, Parameter, Distance
move_13 = Move(Geometry=pt_12, Motion=Vector(0, 0, 10))  # -> Geometry, Transform
shatter = Shatter(Curve=intcrv.Curve, Parameters=crv_cp_5.Parameter)  # -> reparameterize(Segments)
shatter_2 = Shatter(Curve=intcrv_2.Curve, Parameters=crv_cp_6.Parameter)  # -> reparameterize(Segments)
graft_21 = GraftTree(Tree=shatter, IncludeEmptyLists=True, IncludeNullItems=True)  # -> simplify(Tree)
graft_22 = GraftTree(Tree=shatter_2, IncludeEmptyLists=True, IncludeNullItems=True)  # -> simplify(Tree)
merge_9 = Merge(Data1=graft_17, Data2=graft_22, Data3=graft_21)
netsurf_2 = NetworkSurface(CurvesU=weave_3, CurvesV=merge_9, Continuity=Slider(2, range=0..3))
Z_13 = UnitZ(Factor=1)
contour_2 = Contour(Shape=netsurf_2, Point=Point(0, 0, 0), Direction=Z_13, Distance=Slider(1, range=0..1))
